# Grasshopper definition test.gh (Grasshopper 1.0.7)

vector_xyz = VectorXYZ(XComponent=0, YComponent=0, ZComponent=0)  # -> Vector, Length
point = Point(vector_xyz.Vector)
arc = Arc(Plane=point, Radius=1, Angle=Domain(0, 3.141592654))  # -> Arc, Length
sphere = Sphere(Base=point, Radius=1)
